# Grasshopper definition 01_Simple_Export.gh (Grasshopper 1.0.7)

# ----
# Building Mass
height_m = Panel("3")
len_m = Panel("10")
# 1) Build Model
rectangle = Rectangle(Plane=PlaneXY(0, 0, 0), XSize=len_m, YSize=len_m, Radius=0)  # -> Rectangle, Length
Z = UnitZ(Factor=height_m)
extr = Extrude(Base=rectangle.Rectangle, Direction=Z)
cap = CapHoles(Brep=extr)

# ----
# Normal Honeybee Components
face = HBFace(geo=cap)  # -> report, faces; plug-in component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
room = HBRoom(faces=flatten(face.faces), conditioned=True)  # -> report, room; plug-in component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
model = HBModel(rooms=flatten(room.room))  # -> report, model; plug-in component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

destination_phpp_path = Panel("C:\LBT2PH_Testing\Output.xlsx")

# ----
# 2) Export to PHPP
# Note: You MUST have the PHPP excel
# file on your computer and in this location
# for this to run (or just re-enter the correct
# location for a blank PHPP to copy). But
# without a PHPP to copy, this won't run.
source_phpp_path = Panel("C:\LBT2PH_Testing\_source.xlsx")

# ----
# 2a) Set TRUE to turn on Excel
toggle = BooleanToggle(False)
lbt_phpp = LBT2PH2PHPPConvertLBTModel(HB_model=model.model)  # -> out, footprint, excel_objects; inputs rooms_included: list, rooms_excluded: list, ud_row_starts: list, estimated_tfa: Boolean, ud_custom: list; plug-in component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
open_excel_workbook = LBT2PHXLOpenWorkbook(run=toggle, source_PHPP_filepath=source_phpp_path, new_PHPP_filepath=destination_phpp_path)  # -> excel; inputs run: Boolean; plug-in component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
# 2b) Once you are ready,
# connect 'excel_' to '_excel'
write_to_excel_workbook = LBT2PHXLWriteToWorkbook(XL_Objects=lbt_phpp.excel_objects)  # -> excel, numWrites; inputs XL_Objects: tree; plug-in component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
