# Grasshopper definition 02_Full_Model.gh (Grasshopper 1.0.7)

# FIRST FLOOR LEVEL
brep_first_floor = Brep(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)
# CREATE HB ROOMS [ZONES]
# SECOND FLOOR LEVEL
brep_second_floor = Brep(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)
geo_first_floor_windows = Geometry(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)
geo_second_floor_windows = Geometry(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)

aperture = HBAperture(geo=geo_first_floor_windows)  # -> report, apertures; plug-in component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
phpp_aperture = LBT2PHPHPPAperture(apertures=aperture.apertures)  # -> out, apertures; inputs apertures: list, frames: list, glazings: list, installs: list, install_depth: list; plug-in component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

aperture_2 = HBAperture(geo=geo_second_floor_windows)  # -> report, apertures; plug-in component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
phpp_aperture_2 = LBT2PHPHPPAperture(apertures=aperture_2.apertures)  # -> out, apertures; inputs apertures: list, frames: list, glazings: list, installs: list, install_depth: list; plug-in component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

roomsolid = HBRoomFromSolid(geo=flatten(brep_second_floor), name="Second Floor", conditioned=True)  # -> report, rooms; plug-in component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
roomsolid_2 = HBRoomFromSolid(geo=flatten(brep_first_floor), name="First_Floor", conditioned=True)  # -> report, rooms; plug-in component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
addsubface = HBAddSubface(hb_obj=flatten(roomsolid.rooms), sub_faces=flatten(phpp_aperture_2.apertures))  # -> hb_obj; plug-in component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
addsubface_2 = HBAddSubface(hb_obj=flatten(roomsolid_2.rooms), sub_faces=flatten(phpp_aperture.apertures))  # -> hb_obj; plug-in component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
expression = Expression(Expression="1/24")
expression_2 = Expression(Expression="23/24")
vent_schedule = LBT2PHVentSchedule(operationTime_high=expression, operationTime_med=expression_2)  # -> out, phpp_ventilation_sched; plug-in component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
brep_tfa_surfaces = Brep(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)
brep_tfa_surfaces_2 = Brep(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)
phpp_spaces = LBT2PHCreatePHPPSpaces(
    TFA_surfaces=flatten(brep_tfa_surfaces),
    vent_flowrate_source="UD",
    phpp_vent_schedule=vent_schedule.phpp_ventilation_sched,
    HB_rooms=addsubface)  # -> out, space_breps, phpp_spaces, HB_rooms; inputs TFA_surfaces: list, spaces_geometry: list of Guid, HB_rooms: list, set_honeybee_loads: Boolean; plug-in component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
phpp_spaces_2 = LBT2PHCreatePHPPSpaces(
    TFA_surfaces=flatten(brep_tfa_surfaces_2),
    vent_flowrate_source="UD",
    phpp_vent_schedule=vent_schedule.phpp_ventilation_sched,
    HB_rooms=addsubface_2)  # -> out, space_breps, phpp_spaces, HB_rooms; inputs TFA_surfaces: list, spaces_geometry: list of Guid, HB_rooms: list, set_honeybee_loads: Boolean; plug-in component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
merge = Merge(Data1=phpp_spaces.HB_rooms, Data2=phpp_spaces_2.HB_rooms)
solveadj = HBSolveAdjacency(rooms=flatten(merge), run=Toggle(True))  # -> report, adj_rooms; plug-in component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

# ---- group: Visualize
vizbytype = HBVisualizeByType(hb_objs=solveadj.adj_rooms)  # -> walls, interior_walls, roofs, ceilings, exterior_floors, interior_floors, air_walls, apertures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; plug-in component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

# ----
panel = Panel("http://climate.onebuilding.org/WMO_Region_4_North_and_Central_America/USA_United_States_of_America/NY_New_York/USA_NY_New.York-Kennedy.Intl.AP.744860_TMY3.zip")
downloadepw = LBDownloadWeather(weather_URL=panel)  # -> epw_file, stat_file, ddy_file; plug-in component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
window_reveals = LBT2PHShadingWindowReveals(HB_rooms=flatten(solveadj.adj_rooms))  # -> out, HB_rooms, port, window_names, window_surfaces, port_2, window_surrounds, envelope_surfaces_punched, envelope_surfaces; inputs HB_rooms: list; plug-in component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
importepw = LBImportEPW(epw_file=downloadepw.epw_file)  # -> location, dry_bulb_temperature, dew_point_temperature, relative_humidity, wind_speed, wind_direction, direct_normal_rad, diffuse_horizontal_rad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; plug-in component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
smooth = SettingsQuality()
data = Data(importepw.diffuse_horizontal_rad)
data_2 = Data(importepw.location)
data_3 = Data(importepw.direct_normal_rad)
toggle = BooleanToggle(False)

# ---- group: Winter
data_diff_rad = Data(data)
data_location = Data(data_2)
data_direct_rad = Data(data_3)
# SHADING
panel_2 = Panel("11")
analysisperiod = LBAnalysisPeriod(start_month=panel_2, start_day=1, start_hour=0, end_month="4", end_day="15")  # -> period, hoys, dates; plug-in component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
skymatrix = LBCumulativeSkyMatrix(location=data_location, direct_rad=data_direct_rad, diffuse_rad=data_diff_rad, hoys=analysisperiod.hoys)  # -> report, sky_mtx; plug-in component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

# ---- group: Summer
data_diff_rad_2 = Data(data)
data_location_2 = Data(data_2)
data_direct_rad_2 = Data(data_3)
analysisperiod_2 = LBAnalysisPeriod(start_month="5", start_day=1, start_hour=0, end_month="9")  # -> period, hoys, dates; plug-in component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
skymatrix_2 = LBCumulativeSkyMatrix(location=data_location_2, direct_rad=data_direct_rad_2, diffuse_rad=data_diff_rad_2, hoys=analysisperiod_2.hoys)  # -> report, sky_mtx; plug-in component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

# ----
calc_seasonal_radiation = LBT2PHShadingSeasonalRadiation(
    winter_sky_mtx=skymatrix.sky_mtx,
    summer_sky_mtx=skymatrix_2.sky_mtx,
    shading_Mesh_Settings=smooth,
    grid_size="0.1",
    HB_rooms=window_reveals.HB_rooms,
    window_names=flatten(window_reveals.window_names),
    window_surfaces=flatten(window_reveals.window_surfaces),
    window_surrounds=simplify(window_reveals.window_surrounds),
    envelope_surfaces_punched=flatten(window_reveals.envelope_surfaces_punched),
    parallel=toggle,
    run=toggle)  # -> out, HB_rooms, window_names, winter_radiation_shaded, winter_radiation_unshaded, summer_radiation_shaded, summer_radiation_unshaded, port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; inputs HB_rooms: list, window_names: list, window_surfaces: list of GeometryBase, window_surrounds: tree of GeometryBase, envelope_surfaces_punched: list of GeometryBase, additional_shading_surfaces: list of GeometryBase, parallel: Boolean, run: Boolean; plug-in component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
division = Division(A=calc_seasonal_radiation.winter_radiation_shaded, B=calc_seasonal_radiation.winter_radiation_unshaded)
division_2 = Division(A=calc_seasonal_radiation.summer_radiation_shaded, B=calc_seasonal_radiation.summer_radiation_unshaded)
apply_shading_factors = LBT2PHShadingApplyFactors(
    HB_rooms=calc_seasonal_radiation.HB_rooms,
    window_names=flatten(calc_seasonal_radiation.window_names),
    winter_shading_factors=flatten(division),
    summer_shading_factors=flatten(division_2))  # -> out, HB_rooms; inputs HB_rooms: list, window_names: list, winter_shading_factors: list, summer_shading_factors: list; plug-in component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
vent_duct = LBT2PHVentDuct(ductLength=flatten("6'"), ductWidth="6\"", insulThickness="4in")  # -> out, hrvDuct; inputs ductLength: list, ductWidth: list, insulThickness: list, insulConductivity: list; plug-in component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
# FRESH-AIR VENT.
panel_3 = Panel("Zehnder ComfoAir Q600ERV")
hrv_erv_unit = LBT2PHVentUnit(name=panel_3, HR_eff="80", MR_eff="68", elec_eff="0.22", frost_temp="-8")  # -> out, ventUnit; plug-in component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
vent_system = LBT2PHVentSystem(
    vent_system_type="1-Balanced PH ventilaiton with HR",
    vent_system_name="Whole-House",
    vent_unit=hrv_erv_unit.ventUnit,
    hrv_duct_02=vent_duct.hrvDuct,
    HB_rooms=apply_shading_factors.HB_rooms)  # -> out, HB_rooms; inputs hrv_duct_01: list, hrv_duct_02: list, exhaust_vent_units: list, HB_rooms: list; plug-in component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
panel_4 = Panel("""-27.6	24.1	5.66	4.51
-23.0	24.6	6.52	3.39
-18.4	25.1	7.38	2.84
-13.8	25.5	8.24	2.60
-9.7	26.6	10.21	2.64
-5.5	27.6	12.06	2.43
-26.3	23.2	2.83	2.47
-21.5	23.5	3.26	2.66
-16.7	23.9	3.69	2.89
-11.9	24.2	4.12	3.06
-7.3	24.9	5.11	3.39
-2.8	25.6	6.03	3.38""")
kw = Panel("3")
cfm = Panel("600 cfm")
# Heating / Cooling
panel_5 = Panel("DHW HP")
cooling_recirc = LBT2PHCoolingRecirc(max_cooling_cap=kw, vol_flow_at_nom_power=cfm)  # -> out, recirc_air_cooling; inputs on_off_mode: Boolean, variable_vol: Boolean; plug-in component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
heating_hp_options = LBT2PHHeatingHPOptions(design_forward_water_temp="24", hp_distribution="2-Radiators")  # -> out, hp_options; plug-in component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
heating_hp = LBT2PHHeatingHP(unit_name=panel_5)  # -> out, heat_pump; inputs fromPHPP: list, temps_source: list, temps_sink: list, heating_capacities: list, COPs: list; plug-in component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
heating_hp_2 = LBT2PHHeatingHP(unit_name="Eds Custom ASHP", fromPHPP=panel_4, dt_sink="0")  # -> out, heat_pump; inputs fromPHPP: list, temps_source: list, temps_sink: list, heating_capacities: list, COPs: list; plug-in component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
heating_cooling_systems = LBT2PHHeatingSystems(
    primary_heat_generation="2-Heat Pump(s)",
    secondary_heat_generation="5-Direct Electric",
    dhw_frac_primary="0",
    mech_cooling=Toggle(True),
    hp_heating=heating_hp_2.heat_pump,
    hp_DHW=heating_hp.heat_pump,
    hp_options=heating_hp_options.hp_options,
    recirc_air_cooling=cooling_recirc.recirc_air_cooling,
    HB_rooms=vent_system.HB_rooms)  # -> out, HB_rooms; inputs mech_cooling: Boolean, HB_rooms: list; plug-in component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
ga = Panel("80Ga")
panel_6 = Panel("4")
# DHW
dhw_tank = LBT2PHDHWTank(tank_type="2-DHW only", tank_HLrate=panel_6, tank_volume=ga, tank_standby_frac="0.3")  # -> out, storage_tank; inputs tank_solar: Boolean; plug-in component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
dhw_system = LBT2PHDHWSystem(system_name="Whole-House DHW", tank1=dhw_tank.storage_tank, HB_rooms=heating_cooling_systems.HB_rooms)  # -> out, HB_rooms; inputs circulation_piping: list, branch_piping: list, HB_rooms: list; plug-in component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
ach_50 = Panel("0.6")
pa = Panel("50")
# NAT. AIRFLOW
airtightness = LBT2PHAirtightness(HB_rooms=flatten(dhw_system.HB_rooms), n50=ach_50, blower_pressure=pa)  # -> out, HB_rooms; inputs HB_rooms: list; plug-in component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
ach = Panel("1.0")
summer_vent = LBT2PHSummerVentilation(HB_rooms=airtightness.HB_rooms, use_default=Toggle(True), nighttime_ach=ach)  # -> out, HB_rooms; inputs HB_rooms: list, use_default: Boolean; plug-in component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
model = HBModel(rooms=flatten(summer_vent.HB_rooms), name="Eds_First_House")  # -> report, model; plug-in component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
# MODEL CONFIG.
phpp_occupancy = LBT2PHLoadsByPHPPOccupancy(set_honeybee_loads=False, HB_model=model.model)  # -> out, occupancy_sch, ppl_per_area, HB_model; inputs set_honeybee_loads: Boolean; plug-in component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
phpp_setup = LBT2PH2PHPPSetup(primary_energy="2-PER Renewable", HB_model=phpp_occupancy.HB_model)  # -> out, HB_model; plug-in component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
data_to_phpp = Data(phpp_setup.HB_model)
data_to_osm = Data(phpp_setup.HB_model)
lbt_phpp = LBT2PH2PHPPConvertLBTModel(HB_model=data_to_phpp)  # -> out, footprint, excel_objects; inputs rooms_included: list, rooms_excluded: list, ud_row_starts: list, estimated_tfa: Boolean, ud_custom: list; plug-in component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
path = FilePath("C:\LBT2PH_example\Source_PHPP_File.xlsx")
# EXPORT TO PHPP
panel_7 = Panel(path)
open_excel_workbook = LBT2PHXLOpenWorkbook(run=Toggle(False), source_PHPP_filepath=panel_7, new_PHPP_filepath="C:\LBT2PH_example\My_Results.xlsx")  # -> excel; inputs run: Boolean; plug-in component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
write_to_excel_workbook = LBT2PHXLWriteToWorkbook(excel=open_excel_workbook, useDiff=Toggle(False), XL_Objects=lbt_phpp.excel_objects)  # -> excel, numWrites; inputs XL_Objects: tree; plug-in component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
panel_8 = Panel(write_to_excel_workbook.numWrites)
